# Grasshopper definition GrassHopperTest000.gh (Grasshopper 1.0.7)

number = Number([10, 55, 41, 35, 84, 9])
ghpython_script = GhPythonScript(x=number)  # -> out, a
# ---------- ghpython_script: Python ----------
import Rhino
#import grasshopper classes
import clr
clr.AddReference("Grasshopper")
from Grasshopper.Kernel.Data import GH_Path
from Grasshopper import DataTree

newlist = []
#newlist = x[]

graftedTree = DataTree[object]()
for i in range(len(newlist)):
    str =newlist[i]
    path = GH_Path(i)
    graftedTree.AddRange([str],path)

A = graftedTree
# ---------- end ghpython_script ----------
panel = Panel(ghpython_script.out)
ghpython_script_2 = GhPythonScript()  # -> Out, A
